# Grasshopper definition RadialSymmetry_v1.gh (Grasshopper 1.0.7)

# ----
# Choose number of axis          >>>
# 
# Choose rotation angle          >>>
# (optional)
number_of_axis = Slider(6, range=0..100)
# Developed by Danijel Sivinjski
# Uncopyrighted, feel free to do whatever you want
# 
# www.infimensions.com
# cluster@infimensions.com
rotation_angle = Slider(0, range=-360..360)
rad = Radians(Degrees=rotation_angle)

# ----
# Choose plane
# 1. Right click on plane        >>>
# 2. Set one Plane
# 3. Choose plane in Rhino command
# Wire coordinates or point to 'Origin'
# depending on which one you choose
pln = Plane(PlaneXY(0, 0, 0))
# Choose origin point            >>>
# coordinates {x, y, z}
# ---------------------
# Or use Rhino point             >>>
panel = Panel("{0, 0, 0}")
set_origin = Point()
plane = Panel(pln)
pl_origin = PlaneOrigin(Base=pln, Origin=panel)

# ----
# Radial Symmetry
# by INFIMENSIONS
# Choose a Rhino layer           >>>
# 
# Or use asterisk (*) to include all layers
# By default,
# hidden objects are not included
# and locked objects are included.
# 
# Right click on 'Geometry Pipeline'
# to change if needed.
rhino_layer_s = GeometryPipeline(
    GroupByLayer=True,
    GroupByType=False,
    IncludeHidden=False,
    IncludeLocked=True,
    LayerFilter="*",
    NameFilter="*",
    SublayerFiltering=True,
    TypeFilter=1073741885)
objdet = ObjectDetails(Object=rhino_layer_s)  # -> Referenced, Available, Name, Layer, Colour, Guid
layers_included = Panel(objdet.Layer)
objects_included = Panel(rhino_layer_s)

arrpolar = PolarArray(Geometry=rhino_layer_s, Plane=pl_origin, Count=number_of_axis, Angle=6.283185307)  # -> Geometry, Transform
# Choose color of preview in Rhino   >>>
rotate = Rotate(Geometry=arrpolar.Geometry, Angle=rad, Plane=pl_origin)  # -> Geometry, Transform
color = ColourSwatch(SwatchColor=RGB(255, 255, 255))

# ----
# When finished, create a new layer in Rhino.
# 
# <<<   Right click on 'Custom Preview'
#       and 'Bake' to that layer.
preview = CustomPreview(Geometry=rotate.Geometry, Material=color)
